# Grasshopper definition solidLoader.gh (Grasshopper 1.0.7)

panel = Panel("Users/franklindyer/Documents/dev/CompDesign/polyhedra/archimedean-solids/unit-snub-dodecahedron.solid")
python = GhPythonScript(filepath=panel)  # -> out, vertices, faces
# ---------- python: Python ----------
__author__ = "franklindyer"

import rhinoscriptsyntax as rs

## filepath = "Users/franklindyer/Documents/dev/CompDesign/polyhedra/archimedean-solids/unit-rhombicosidodecahedron.solid"

vertices = []
faces = []

section = 0
with open(filepath) as f:
    for line in f:
        if line=="VERTICES:\n" or line=="FACES:\n": 
            section += 1
            continue
        if section == 1:
            coords = line.split()
            vertex = (float(coords[0]), float(coords[1]), float(coords[2]))
            rh_vertex = rs.CreatePoint(vertex)
            vertices.append(rh_vertex)
        if section == 2:
            ids = [int(id) for id in line.split()]
            points = [vertices[id] for id in ids]
            face = rs.AddPolyline(points)
            faces.append(face)
f.close()
# ---------- end python ----------
panel_2 = Panel(python.out)
pt = Point(python.vertices)
