# Grasshopper definition cylindrical-tutorial.gh (Grasshopper 1.0.7)

num_pts = Slider(5, range=5..20)
num_levels = Slider(10, range=2..25)
python = GhPythonScript(num_pts=num_pts, num_levels=num_levels)  # -> out, a, b; inputs num_pts: Int32, num_levels: Int32
# ---------- python: Python ----------
import rhinoscriptsyntax as rs
import math

print("hello world!")

class CylindricalPoint:
    
    def __init__(self, x, y, z):
        self.r = math.sqrt(x**2 + y**2)
        self.theta = math.atan2(x, y)
        self.z = z
        
    def to_rectangular(self):
        x = self.r * math.cos(self.theta)
        y = self.r * math.sin(self.theta)
        z = self.z
        return (x, y, z)
        
    def to_rhinopoint(self):
        rect_coords = self.to_rectangular()
        rhino_pt = rs.CreatePoint(rect_coords[0], rect_coords[1], rect_coords[2])
        return rhino_pt
    
    def clone(self):
        pp = CylindricalPoint(0, 0, 0)
        pp.r, pp.theta, pp.z = self.r, self.theta, self.z
        return pp
        

##p1 = CylindricalPoint(10, 0, 0)
##base = []

##for i in range(0, num_pts):
##    base.append(p1.clone())
##    p1.theta += 2*math.pi/num_pts
    
layers = []

## for i in range(0, num_levels):
##    next_layer = [p.clone().to_rhinopoint() for p in base]
##    layers.append(next_layer)
##    for p in base:
##        p.theta += math.pi/(4*(num_levels-1))
##        p.z += 3 + 5*i/num_levels
##        p.r = 7 + 3 * math.sin(2*math.pi*i/num_levels)
z = 0
r = 7
for i in range(0, num_levels):
    z += 3 + 5*i/num_levels
    r = 7 + 3*math.sin(2*math.pi*i/num_levels)
    layers.append(rs.AddCircle((0, 0, z), r))
    
a = layers

##ln = []

##for layer in layers:
##    for i in range(0, num_pts):
##        p1 = layer[i-1]
##        p2 = layer[i]
##        l = rs.AddLine(p1, p2)
##        ln.append(l)
        
##for n in range(0, num_levels-1):
##    for i in range(0, num_pts):
##        p1 = layers[n][i]
##        p2 = layers[n+1][i]
##        l = rs.AddLine(p1, p2)
##        ln.append(l)
        
##b = ln
# ---------- end python ----------
pipe_radius = Slider(0.915, range=0..4)
line = Line(python.b)
panel = Panel(python.out)
loft = Loft(Curves=python.a, Options={Adjust=False, Closed=False, LoftEnds=0, LoftSimp=0, LoftType=0, Rebuild=10, Refit=0.01})
pipe = Pipe(Curve=line, Radius=pipe_radius, Caps=0)  # disabled
