# Grasshopper definition external-scripts-test.gh (Grasshopper 1.0.7)

python = GhPythonScript()  # -> out, a
# ---------- python: Python ----------
__author__ = "franklindyer"

import rhinoscriptsyntax as rs
import sys

## for folder in sys.path: print(folder)

f = open("test.txt", "w")
f.write("testing 1 2 3")
f.close()

print("Hello World!")
# ---------- end python ----------
panel = Panel(python.out)
