# Grasshopper definition polar-play.gh (Grasshopper 1.0.7)

num_levels = Slider(18, range=3..20)
num_pts = Slider(8, range=5..20)
python = GhPythonScript(num_levels=num_levels, num_pts=num_pts)  # -> out, a; inputs num_levels: Int32, num_pts: Int32
# ---------- python: Python ----------
import rhinoscriptsyntax as rs
import math

print("hello world!")

class CylindricalPoint:
    
    def __init__(self, x, y, z):
        self.r = math.sqrt(x**2 + y**2)
        self.theta = math.atan2(x, y)
        self.z = z
        
    def to_rectangular(self):
        x = self.r * math.cos(self.theta)
        y = self.r * math.sin(self.theta)
        z = self.z
        return (x, y, z)
        
    def clone(self):
        pp = CylindricalPoint(0, 0, 0)
        pp.r, pp.theta, pp.z = self.r, self.theta, self.z
        return pp
        
    def rotate(self, phi):
        image = CylindricalPoint(0, 0, 0)
        image.r = self.r
        image.theta = self.theta + phi
        image.z = self.z
        return image
        
    def dilate(self, coef):
        image = CylindricalPoint(0, 0, 0)
        image.r = self.r * coef
        image.theta = self.theta
        image.z = self.z
        return image
        
    def lift(self, height):
        image = CylindricalPoint(0, 0, 0)
        image.r = self.r
        image.theta = self.theta
        image.z = self.z + height
        return image
    
cp1 = CylindricalPoint(10, 0, 0)
    
cyl_pts = [cp1.rotate(2*math.pi * i / num_pts) for i in range(0, int(num_pts))]
top_cyl_pts = [] + cyl_pts

rot_pds = 4
max_rot = math.pi/6
comp_pds = 0
min_h = 4
max_h = 6

for i in range(0, int(num_levels)):
    print(i)
    phi = max_rot * math.cos(2*math.pi*rot_pds*i/num_levels)
    h = min_h + (max_h - min_h) * math.sin(math.pi*comp_pds*i/num_levels)**2
    new_top_pts = [p.rotate(phi).lift(h) for p in top_cyl_pts]
    cyl_pts = cyl_pts + new_top_pts
    top_cyl_pts = [] + new_top_pts

rect_pts = [p.to_rectangular() for p in cyl_pts]
a = [rs.CreatePoint(p[0], p[1], p[2]) for p in rect_pts]
# ---------- end python ----------
panel = Panel(python.out)
pt = Point(python.a)
